# Grasshopper definition Speculative Column.gh (Grasshopper 1.0.7)
# Copyright: Use it.  Mod it.  Share it. Just please give credit and keep this party going.
# Copyright: Use it.  Mod it.  Share it. Just please give credit and kepp this party going.
# plug-ins: Pufferfish

channel_selector = Slider(14, range=0..54)
angle_selector = Slider(35, range=0..55)
number_of_parts = Slider(81, range=0..1000)

# ---- group: column generator
button = Button()

# ---- group: turns on and off the inpuut to the simplification function
toggle = BooleanToggle(False)

# ----
target_dimension = Slider(165, range=0..1000)
target_dimension_2 = Slider(140, range=0..1000)

# ---- group: angle selector
# 10/5/23
# This is basically what I had in mind when I started, though my conception was only loose.
# 
# The addition of the channel shape makes for such wonderful complexity! and allows the number of possible parts to grow enourmously. There is certainly still room to push it further.
# 
# Different shapes would be interesting. Maybe angles channels like in one of my reference photos. Also I’m still using the wasp components very simply, I’m sure more interesting results
# could be found by gaining a deeper understanding. Also, different way’s of dealing with the pattern that wasp puts out. I’m essetially reusing the mirroring process that gave me the original column I was
# working with, I can imagine some exciting things happening If I pushed and pulled it in different directions. Also integrating the plate better into the final column would be good.
# 10/6/23
# Essentially the same generation algorithm as before, except I have cleaned up the tree a bit.
# 
# 
# Duplicate curves generated by wasp are culled, as well as invalid curves that came from somewhere….
# 
# 
# I’ve also added a function that simplifies the final curve to make something that is hopefully possible to draw. Hopefully this will even make some of the larger curves feasible.
crv = Curve([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])
item = ListItem(List=crv, Index=angle_selector, Wrap=True)

# ---- group: collection of channels
crv_2 = Curve([<curve referenced from the Rhino model> x54])

# ----
len = Length(Curve=crv_2)
len_2 = Length(Curve=crv)
target_dimension_3 = Slider(150, range=0..1000)

# ---- group: Choose curve and put it at 0,0
item_2 = ListItem(List=crv_2, Index=channel_selector, Wrap=True)
bbox = BoundingBox(Content=item_2, Plane=PlaneXY(0, 0, 0))  # -> Box, Box_2
debrep = DeconstructBrep(Brep=bbox.Box)  # -> Faces, Edges, Vertices
item_3 = ListItem(List=debrep.Edges, Index=0, Wrap=True)
end = EndPoints(Curve=item_3)  # -> Start, End
pt = Point(Point(0, 0, 0))
move2pt = MoveToPoint(Geometry=item_2, PointA=end.Start, PointB=pt)  # -> Moved, Vector, Transform

# ----
debrep_2 = DeconstructBrep(Brep=move2pt.Moved)  # -> Faces, Edges, Vertices

# ---- group: selecting the top and bottom faces of the channel
midpt = CurveMiddle(Curve=debrep_2.Edges)
pdecon = Deconstruct(Point=midpt)  # -> XComponent, YComponent, ZComponent
sort = SortList(Keys=pdecon.YComponent, ValuesA=midpt)  # -> Keys, ValuesA
sort_2 = SortList(Keys=pdecon.YComponent, ValuesA=debrep_2.Edges)  # -> Keys, ValuesA
item_4 = ListItem(List=sort_2.ValuesA, Index=0, Wrap=True)  # -> Item1, Item
item_5 = ListItem(List=sort.ValuesA, Index=0, Wrap=True)  # -> Item1, Item

# ---- group: move the angle to 0,0
bbox_2 = BoundingBox(Content=item, Plane=PlaneXY(0, 0, 0))  # -> Box, Box_2
debrep_3 = DeconstructBrep(Brep=bbox_2.Box)  # -> Faces, Edges, Vertices
item_6 = ListItem(List=reverse(debrep_3.Edges), Index=0, Wrap=True)
len_3 = Length(Curve=item_6)
midpt_2 = CurveMiddle(Curve=item_6)
division = Division(A=len_3, B=2)
pt_2 = ConstructPoint(XCoordinate=0, YCoordinate=division, ZCoordinate=0)
move2pt_2 = MoveToPoint(Geometry=item, PointA=midpt_2, PointB=pt_2)  # -> Moved, Vector, Transform

# ---- group: grabbing longest side
len_4 = Length(Curve=debrep_2.Edges)
sort_3 = SortList(Keys=len_4, ValuesA=debrep_2.Edges)  # -> Keys, ValuesA
item_7 = ListItem(List=reverse(sort_3.ValuesA), Index=0, Wrap=True)

# ----
dfab_prusa_p = ConfigDFabPrusa_P()
config_pen = ConfigPen(primary_config_for_3dp_f=dfab_prusa_p)  # -> printer_volume_domain_box_4, xy_tolerance_mm_4, line_width_mm_4, print_speed_mm_sec_4, xy_rapid_speed_mm_sec_4, z_rapid_speed_mm_sec_4, z_clearance_mm_4, z_clearance_start_and_end_mm_4, primary_config_for_3dp_f_2

# ---- group: LENGTH OF angle side
len_5 = Length(Curve=item_6)

# ----
Z = UnitZ(Factor=1)

# ---- group: finding center of longest sides for wasp connector
debrep_4 = DeconstructBrep(Brep=move2pt_2.Moved)  # -> Faces, Edges, Vertices
len_6 = Length(Curve=debrep_4.Edges)
sort_4 = SortList(Keys=len_6, ValuesA=debrep_4.Edges)  # -> Keys, ValuesA
split = SplitList(List=reverse(sort_4.ValuesA), Index="2")  # -> ListA, ListB
midpt_3 = CurveMiddle(Curve=split.ListA)
pdecon_2 = Deconstruct(Point=midpt_3)  # -> XComponent, YComponent, ZComponent
sort_5 = SortList(Keys=pdecon_2.XComponent, ValuesA=midpt_3)  # -> Keys, ValuesA
sort_6 = SortList(Keys=pdecon_2.XComponent, ValuesA=split.ListA)  # -> Keys, ValuesA
item_8 = ListItem(List=reverse(sort_6.ValuesA), Index=0, Wrap=True)  # -> Item, Item1
extr = Extrude(Base=[item_8.Item1, item_8.Item], Direction=Z)

# ---- group: this sort is necessary because some of the channels shapes have different start and end points for this line
end_2 = EndPoints(Curve=item_7)  # -> Start, End
pdecon_3 = Deconstruct(Point=[end_2.End, end_2.Start])  # -> XComponent, YComponent, ZComponent
sort_7 = SortList(Keys=pdecon_3.YComponent, ValuesA=flatten([end_2.Start, end_2.End]))  # -> Keys, ValuesA
item_9 = ListItem(List=sort_7.ValuesA, Index=0, Wrap=True)  # -> Item, Item1

# ---- group: extrude angle for wasp
extr_2 = Extrude(Base=move2pt_2.Moved, Direction=Z)
cap = CapHoles(Brep=extr_2)

# ---- group: extrude for wasp
extr_3 = Extrude(Base=move2pt.Moved, Direction=Z)
cap_2 = CapHoles(Brep=extr_3)

# ---- group: extruding the connection planes
extr_4 = Extrude(Base=[item_4.Item, item_4.Item1, item_7], Direction=Z)
area = Area(Geometry=extr_4)  # -> Area, Centroid

# ---- group: points
area_2 = Area(Geometry=extr)  # -> Area, Centroid

# ---- group: up
ln = Line(StartPoint=area_2.Centroid, EndPoint=sort_5.ValuesA)

# ----
mesh = Mesh(cap)

# ---- group: wasp proxy
attribute = Wasp_Attribute(ID="detailangle", VAL=cap, TR="true")  # -> ATTR; inputs VAL: list, TR: Boolean; plug-in component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

# ---- group: making lines to give the channels three attachment points on their longest side, these are the outer two
Y = UnitY(Factor=1)
neg = Negative(Value=Y)
line = LineSDL(Start=item_9.Item1, Direction=Y, Length=len_5)
line_2 = LineSDL(Start=item_9.Item, Direction=neg, Length=len_5)
# I tried making the number of connection points on the channels longest sides correspond to the length of the angle peices, But I couldn't quite figure it out
midpt_4 = CurveMiddle(Curve=[line, line_2])

# ---- group: channel proxy
attribute_2 = Wasp_Attribute(ID="detailchannel", VAL=cap_2, TR="true")  # -> ATTR; inputs VAL: list, TR: Boolean; plug-in component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

# ----
number_slider = Slider(0.27, range=0..1)
number_slider_2 = Slider(0.027, range=0..0.1)

# ---- group: third (center) attachment point for the channels longest side
midpt_5 = CurveMiddle(Curve=item_7)

# ----
merge = Merge(Data1=item_5.Item, Data2=item_5.Item1, Data3=midpt_5)

# ---- group: lines for connection UP
ln_2 = Line(StartPoint=area.Centroid, EndPoint=merge)

# ----
panel = Panel("z rapid changed")
dfab_prusa_p_slow = ConfigDFabPrusa_P()

item_10 = ListItem(List=ln_2, Index=0, Wrap=True)
len_7 = Length(Curve=item_10)

# ---- group: moving those two points up to the center of the extrusion
Z_2 = UnitZ(Factor=len_7)
move = Move(Geometry=midpt_4, Motion=Z_2)  # -> Geometry, Transform

# ----
line_3 = Line(ln_2)
pt_3 = Point(area.Centroid)

# ---- group: making lines from the center points to the outside
ln_3 = Line(StartPoint=move.Geometry, EndPoint=midpt_4)

# ---- group: for some reason the connection planes had to be made manually for these two outside points
pt_4 = Point(move.Geometry)
line_4 = Line(ln_3)
yz = YZPlane(Origin=pt_4)
align = AlignPlane(Plane=yz, Direction=line_4)  # -> Plane, Angle

# ---- group: splitting up the center connection on the longest side from the top and bottom connection points
item_11 = ListItem(List=line_3, Index=0, Wrap=True)  # -> Item1, Item, Item1_2
# these three are grouped together because they are easier to make
item_12 = ListItem(List=pt_3, Index=0, Wrap=True)  # -> Item1, Item, Item1_2

# ----
X = UnitX(Factor=Slider(-17, range=-30..31))
Y_2 = UnitY(Factor=Slider(-9, range=-10..-9))

# ---- group: wasp angle part
conndir = Wasp_ConnectionFromDirection(GEO=mesh, CEN=area_2.Centroid, UP=ln)  # -> CONN, PLN_OUT; inputs CEN: list of Point3d, UP: list of Curve, T: list; plug-in component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
collider = Wasp_Collider(GEO=cap, ALL="true")  # -> COLL; inputs GEO: list of Mesh, MUL: Boolean, ALL: Boolean, CONN: list; plug-in component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
part = Wasp_BasicPart(NAME="right", GEO=cap, CONN=flatten(conndir.CONN), COLL=collider, ATTR=attribute)  # -> PART; inputs GEO: Mesh, CONN: list, ATTR: list; plug-in component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

# ---- group: wasp channel part / angle connection
connpln = Wasp_ConnectionFromPlane(PLN=align.Plane)  # -> CONN, PLN_OUT; inputs PLN: list of Plane, T: list; plug-in component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
conndir_2 = Wasp_ConnectionFromDirection(GEO=cap_2, CEN=[item_12.Item, item_12.Item1_2], UP=[item_11.Item, item_11.Item1_2])  # -> CONN, PLN_OUT; inputs CEN: list of Point3d, UP: list of Curve, T: list; plug-in component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

# ---- group: wasp channel part / u channel connection
conndir_3 = Wasp_ConnectionFromDirection(GEO=cap_2, CEN=item_12.Item1, UP=item_11.Item1)  # -> CONN, PLN_OUT; inputs CEN: list of Point3d, UP: list of Curve, T: list; plug-in component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

# ---- group: wasp channel part
# these connection nodes are separated because I wanted to try and modulate the way that the u channels connected to each other.
panel_2 = Panel("true")
collider_2 = Wasp_Collider(GEO=cap_2, ALL=panel_2)  # -> COLL; inputs GEO: list of Mesh, MUL: Boolean, ALL: Boolean, CONN: list; plug-in component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
part_2 = Wasp_BasicPart(
    NAME="channel",
    GEO=cap_2,
    CONN=flatten([conndir_3.CONN, conndir_2.CONN, connpln.CONN]),
    COLL=collider_2,
    ATTR=attribute_2)  # -> PART; inputs GEO: Mesh, CONN: list, ATTR: list; plug-in component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

# ---- group: wasp rules - generates all possible rules
rulegen = Wasp_RulesGenerator(PART=[part, part_2])  # -> R; inputs PART: list, SELF_P: Boolean, SELF_C: Boolean, TYP: Boolean, GR: list; plug-in component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

# ----
# my original intention was for the center connection point of the long side of the channel to only connect to the same point on other channels and not any of the angle shapes. I think that this cull index makes that happen, but I'm not certain that it helps make more interesting column. I think there area also probably more elegant ways to do this.
panel_3 = Panel("""2
9
14
15
17
18
19
20
23
30
37
44""")
cull_i = CullIndex(List=rulegen, Indices=panel_3, Wrap=True)

# ---- group: original angle z bar construction that is no longer really being ised
# I found a lot of standard steel angle shapes online.
# putting the z bar offset to .5 will give you the "standard column" based on the reference
z_bar_offset = Slider(0.9, range=0.2..1.2)
angle_shape_selector = Slider(27, range=0..36)
crv_3 = Curve([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])
crv_4 = Curve([<curve referenced from the Rhino model> x36])
item_13 = ListItem(List=crv_3, Index=angle_shape_selector, Wrap=True)
bbox_3 = BoundingBox(Content=item_13, Plane=PlaneXY(0, 0, 0), UnionBox=True)  # -> Box, Box_2
debrep_5 = DeconstructBrep(Brep=bbox_3.Box)  # -> Faces, Edges, Vertices
item_14 = ListItem(List=debrep_5.Edges, Index=0, Wrap=True)
end_3 = EndPoints(Curve=item_14)  # -> Start, End
twn2pts = TweenTwoPoints(PointA=end_3.Start, PointB=end_3.End, Factor=z_bar_offset)
midpt_6 = CurveMiddle(Curve=item_14)
xz = XZPlane(Origin=midpt_6)
yz_2 = YZPlane(Origin=twn2pts)
mirror = Mirror(Geometry=item_13, Plane=xz)  # -> Geometry, Transform
mirror_2 = Mirror(Geometry=item_13, Plane=yz_2)  # -> Geometry, Transform
crv_5 = Curve(flatten([mirror.Geometry, mirror_2.Geometry]))

# ---- group: sort of broken plate function - finding thickness of angle
# this function does not find the exact distance because the mid points of the lines I'm looking for are offset from each other. sometimes it fails as well because I think the number of edges are too different in some of the angle shapes.
debrep_6 = DeconstructBrep(Brep=item_13)  # -> Faces, Edges, Vertices
len_8 = Length(Curve=debrep_6.Edges)
sort_8 = SortList(Keys=len_8, ValuesA=debrep_6.Edges)  # -> Keys, ValuesA
shift = ShiftList(List=sort_8.ValuesA, Shift="-1", Wrap=True)
panel_4 = Panel(sort_8.Keys)
item_15 = ListItem(List=shift, Index=0, Wrap=True)  # -> Item2, Item1, Item
midpt_7 = CurveMiddle(Curve=item_15.Item2)
midpt_8 = CurveMiddle(Curve=item_15.Item1)
pdecon_4 = Deconstruct(Point=midpt_7)  # -> XComponent, YComponent, ZComponent
pdecon_5 = Deconstruct(Point=midpt_8)  # -> XComponent, YComponent, ZComponent
subtraction = Subtraction(A=pdecon_4.XComponent, B=pdecon_5.XComponent)

# ----
number_slider_3 = Slider(0, range=0..100)

# ---- group: column generator
button_2 = Button()

# ---- group: wasp pattern generator thing
stochasticaggregation = Wasp_StochasticAggregation(PART=flatten([part_2, part]), N=number_of_parts, RULES=rulegen, RESET=[button_2, Button(), button])  # -> AGGR, PART_OUT; inputs PART: list, PREV: list, N: Int32, RULES: list, SEED: Int32, MODE: Int32, GC: list, RESET: Boolean; plug-in component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

# ---- group: turning the mesh back into breps with the proxy attribute component
# I don't know why these are orange, they are working as intended
panel_5 = Panel("detailchannel")
getattr = Wasp_GetAttributeByName(PART=stochasticaggregation.PART_OUT, ID="detailangle")  # -> VAL; plug-in component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
getattr_2 = Wasp_GetAttributeByName(PART=stochasticaggregation.PART_OUT, ID=panel_5)  # -> VAL; plug-in component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

# ----
partgeo = Wasp_GetPartGeometry(PART=stochasticaggregation.PART_OUT)  # -> GEO; plug-in component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
clean = CleanTree(RemoveNulls=True, RemoveInvalid=True, RemoveEmpty=False, Tree=[getattr, getattr_2])
number_slider_4 = Slider(1, range=0..1)

# ---- group: changing xylinus to change feedrate
target_dimension_4 = Slider(165, range=0..1000)
target_dimension_5 = Slider(140, range=0..1000)
target_dimension_6 = Slider(150, range=0..1000)
config_pen_2 = ConfigPen(primary_config_for_3dp_f=dfab_prusa_p_slow)  # -> printer_volume_domain_box_4, xy_tolerance_mm_4, line_width_mm_4, print_speed_mm_sec_4, xy_rapid_speed_mm_sec_4, z_rapid_speed_mm_sec_4, z_clearance_mm_4, z_clearance_start_and_end_mm_4, primary_config_for_3dp_f_2

# ---- group: turning the breps back into curves
project = Project(Geometry=clean, Plane=PlaneXY(0, 0, 0))  # -> Geometry, Transform
debrep_7 = DeconstructBrep(Brep=project.Geometry)  # -> Faces, Edges, Vertices

# ----
clean_2 = CleanTree(RemoveNulls=True, RemoveInvalid=True, RemoveEmpty=False, Tree=debrep_7.Edges)
join = JoinCurves(Curves=clean_2, Preserve=False)

# ---- group: list item gets rid of some of the duplicates
item_16 = ListItem(List=join, Index=0, Wrap=True)  # -> flatten(Item)

# ---- group: seems to do a good job deleting duplicate shapes that output from wasp for some reason
midpt_9 = CurveMiddle(Curve=item_16)  # -> flatten(Midpoint)
cullpt = CullDuplicates(Points=midpt_9, Tolerance=0.1, CullMode=3)  # -> Points, Indices, Valence
mindex = MemberIndex(Set=midpt_9, Member=cullpt.Points)  # -> Index, Count
item_17 = ListItem(List=mindex.Index, Index=0, Wrap=True)  # -> Item, Item1
cull_i_2 = CullIndex(List=item_16, Indices=flatten([item_17.Item, item_17.Item1]), Wrap=True)

# ---- group: turning the breps back into curves (continued)
crv_6 = Curve(cull_i_2)

# ---- group: first mirror
bbox_4 = BoundingBox(Content=flatten(crv_6), Plane=PlaneXY(0, 0, 0), UnionBox=True)  # -> Box, Box_2
debrep_8 = DeconstructBrep(Brep=bbox_4.Box)  # -> Faces, Edges, Vertices
item_18 = ListItem(List=debrep_8.Edges, Index=0, Wrap=True)  # -> Item1, Item
midpt_10 = CurveMiddle(Curve=item_18.Item1)
yz_3 = YZPlane(Origin=midpt_10)
mirror_3 = Mirror(Geometry=crv_6, Plane=yz_3)  # -> Geometry, Transform

# ----
crv_7 = Curve(flatten([mirror_3.Geometry, crv_6]))

# ---- group: second mirror
bbox_5 = BoundingBox(Content=crv_7, Plane=PlaneXY(0, 0, 0), UnionBox=True)  # -> Box, Box_2
debrep_9 = DeconstructBrep(Brep=bbox_5.Box)  # -> Faces, Edges, Vertices
item_19 = ListItem(List=debrep_9.Edges, Index=0, Wrap=True)  # -> Item1, Item, Item1_2, Item2
midpt_11 = CurveMiddle(Curve=item_19.Item2)
xz_2 = XZPlane(Origin=midpt_11)
mirror_4 = Mirror(Geometry=crv_7, Plane=xz_2)  # -> Geometry, Transform

# ----
box = EvaluateBox(Box=bbox_5.Box, UParameter=number_slider_3, VParameter=Slider(0.5, range=0..1), WParameter=number_slider_3)  # -> Plane, Point, Include
crv_8 = Curve(flatten([mirror_4.Geometry, crv_7]))

# ---- group: speculative column output
crv_9 = Curve(crv_8)

# ---- group: semi usless plate maker- doesn't always line up but I feel like it looks kind of nice - would be good to integrate it better
bbox_6 = BoundingBox(Content=crv_8, Plane=PlaneXY(0, 0, 0), UnionBox=True)  # -> Box, Box_2
debrep_10 = DeconstructBrep(Brep=bbox_6.Box)  # -> Faces, Edges, Vertices
item_20 = ListItem(List=debrep_10.Edges, Index=0, Wrap=True)  # -> Item1, Item, Item1_2, Item2
len_9 = Length(Curve=item_14)
midpt_12 = CurveMiddle(Curve=item_20.Item1)
multiplication = Multiplication(A=subtraction, B=2)
multiplication_2 = Multiplication(A=len_9, B=2)
neg_2 = Negative(Value=subtraction)
addition = Addition(A=multiplication_2, B=multiplication)
rectangle = Rectangle(Plane=midpt_12, XSize=neg_2, YSize=addition, Radius=".125")  # -> Rectangle, Length
explode = Explode(Curve=rectangle.Rectangle, Recursive=True)  # -> Segments, Vertices
len_10 = Length(Curve=explode.Segments)
sort_9 = SortList(Keys=len_10, ValuesA=explode.Segments)  # -> Keys, reverse(ValuesA)
item_21 = ListItem(List=sort_9.ValuesA, Index=0, Wrap=True)  # -> Item, Item1
midpt_13 = CurveMiddle(Curve=item_21.Item1)
orient = Orient(Geometry=rectangle.Rectangle, Source=midpt_13, Target=midpt_12)  # -> Geometry, Transform
mirror_5 = Mirror(Geometry=orient.Geometry, Plane=yz_3)  # -> Geometry, Transform

# ---- group: speculative column
crv_10 = Curve(crv_8)

# ---- group: for some reason there are some nulls amongst the curves
null = NullItem(Item=crv_10)  # -> NullFlags, InvalidFlags, Description
invbool = InvertBoolean(Boolean=null.NullFlags)  # -> Inverted, Number
# The number of columns that can be generated seems quite limited, I think in this instance learning more about the wasp plugin and tweaking that part of the definition would be beneficial.
cull = CullPattern(List=crv_10, CullPattern=invbool.Inverted)

# ----
# These coould benefit from the plates that attach some of the floatier angles, but I'm not sure yet how to do that.
clean_3 = CleanTree(RemoveNulls=True, RemoveInvalid=True, RemoveEmpty=False, Tree=crv_10)
panel_6 = Panel(crv_10)
filter = StreamFilter(Gate=toggle, Stream0=crv_10)
simplify = SimplifyTree(Tree=filter, Front=False)
panel_7 = Panel(simplify)
branch = TreeBranch(Tree=simplify(filter), Path="{0;0;0;0;}", MaintainPaths=True)
cx = CurveSelf(Curve=filter)  # -> Points, Params

# ---- group: simplifing the curves to draw more easily / turning my curves back into surfaces
boundary = BoundarySurfaces(Edges=graft(filter))  # -> flatten(Surfaces)

# ----
runion = RegionUnion(Curves=flatten(filter))

# ---- group: simplifing the curves to draw more easily / scaling them up very slightly so that the solid difference will work
area_3 = Area(Geometry=boundary)  # -> Area, Centroid
scale = Scale(Geometry=boundary, Center=area_3.Centroid, Factor=Slider(1.001, range=0..10))  # -> Geometry, Transform

# ---- group: simplifing the curves to draw more easily
Z_3 = UnitZ(Factor=1)
number_slider_5 = Slider(3.75, range=0..10)
Z_4 = UnitZ(Factor=Slider(0.125, range=0..1))

# ---- group: simplifing the curves to draw more easily / making them solid
extr_5 = Extrude(Base=scale.Geometry, Direction=Z_3)
cap_3 = CapHoles(Brep=extr_5)
sunion = SolidUnion(Breps=cap_3)

# ---- group: simplifing the curves to draw more easily / making a plane to find the outside curves of the column - the minumum amount of curves to see the shape
bbox_7 = BoundingBox(Content=flatten(extr_5), Plane=PlaneXY(0, 0, 0), UnionBox=True)  # -> Box, Box_2
debox = DeconstructBox(Box=bbox_7.Box)  # -> Plane, X, Y, Z
division_2 = Division(A=Z_3, B=2)
xy = XYPlane(Origin=division_2)
planesrf = PlaneSurface(Plane=xy, XSize=debox.X, YSize=debox.Y)

# ---- group: simplifing the curves to draw more easily / scaling it up so that the solid difference will work better - and to more easily sort it out
scale_2 = Scale(Geometry=planesrf, Center=xy, Factor=number_slider_5)  # -> Geometry, Transform

# ---- group: simplifing the curves to draw more easily (continued)
extr_6 = Extrude(Base=scale_2.Geometry, Direction=Z_4)
sdiff = SolidDifference(BrepsA=extr_6, BrepsB=sunion)
debrep_11 = DeconstructBrep(Brep=scale_2.Geometry)  # -> Faces, Edges, Vertices

# ---- group: simplifing the curves to draw more easily / grabbing only the curves from one of the big faces
debrep_12 = DeconstructBrep(Brep=sdiff)  # -> Faces, Edges, Vertices
item_22 = ListItem(List=debrep_12.Faces, Index=0, Wrap=True)
debrep_13 = DeconstructBrep(Brep=item_22)  # -> Faces, Edges, Vertices

# ---- group: simplifing the curves to draw more easily (continued)
crv_11 = Curve(debrep_13.Edges)
join_2 = JoinCurves(Curves=crv_11, Preserve=False)  # -> simplify(graft(Curves))

# ---- group: simplifing the curves to draw more easily / I suspect that there is a better way of removing the outline, but this seems to work
lng = ListLength(List=debrep_11.Edges)
debrep_14 = DeconstructBrep(Brep=join_2)  # -> Faces, flatten(Edges), Vertices
series = Series(Start=0, Step=1, Count=lng)
panel_8 = Panel(series)
len_11 = Length(Curve=debrep_14.Edges)
sort_10 = SortList(Keys=len_11, ValuesA=debrep_14.Edges)  # -> Keys, reverse(ValuesA)
cull_i_3 = CullIndex(List=sort_10.ValuesA, Indices=panel_8, Wrap=True)

# ---- group: Curves that I think the little machine will have an easier time drawing
join_3 = JoinCurves(Curves=cull_i_3, Preserve=False)

# ---- group: simplified output for drawing
crv_12 = Curve(join_3)

# ----
bbox_8 = BoundingBox(Content=crv_12, Plane=PlaneXY(0, 0, 0), UnionBox=True)  # -> Box, Box_2
debox_2 = DeconstructBox(Box=bbox_8.Box)  # -> Plane, X, Y, Z

# ---- group: get largest xy dim
bbox_9 = BoundingBox(Content=crv_12, Plane=PlaneXY(0, 0, 0), UnionBox=True)  # -> Box, Box_2
debox_3 = DeconstructBox(Box=bbox_9.Box)  # -> Plane, X, Y, Z
dedomain = DeconstructDomain(Domain=debox_3.X)  # -> Start, End
dedomain_2 = DeconstructDomain(Domain=debox_3.Y)  # -> Start, End
subtraction_2 = Subtraction(A=dedomain_2.End, B=dedomain_2.Start)
subtraction_3 = Subtraction(A=dedomain.End, B=dedomain.Start)
max = Maximum(A=subtraction_3, B=subtraction_2)

# ----
dedomain_3 = DeconstructDomain(Domain=debox_2.X)  # -> Start, End
dedomain_4 = DeconstructDomain(Domain=debox_2.Y)  # -> Start, End
subtraction_4 = Subtraction(A=dedomain_4.End, B=dedomain_4.Start)
subtraction_5 = Subtraction(A=dedomain_3.End, B=dedomain_3.Start)
division_3 = Division(A=target_dimension, B=subtraction_5)
division_4 = Division(A=target_dimension_2, B=subtraction_4)
min = Minimum(A=division_3, B=division_4)
division_5 = Division(A=target_dimension_3, B=max)
scale_3 = Scale(Geometry=crv_12, Center=Point(0, 0, 0), Factor=min)  # -> Geometry, Transform
scale_4 = Scale(Geometry=crv_12, Center=Point(0, 0, 0), Factor=division_5)  # -> Geometry, Transform
cntr_prnt = CenterPrintOnPrintBed(geo=scale_3.Geometry, printer_volume_box=config_pen.primary_config_for_3dp_f_2)  # -> G, bed_center, edges_of_printer_build_area, fits
lng_2 = ListLength(List=flatten(cntr_prnt.G))
bbox_10 = BoundingBox(Content=cntr_prnt.G, Plane=PlaneXY(0, 0, 0), UnionBox=True)  # -> Box, Box_2
multiplication_3 = Multiplication(A=lng_2, B=2)
debox_4 = DeconstructBox(Box=bbox_10.Box)  # -> Plane, X, Y, Z
multiplication_4 = Multiplication(A=config_pen.z_clearance_start_and_end_mm_4, B=multiplication_3)
len_12 = Length(Curve=flatten(cntr_prnt.G))
print_crv__p = PrintCurvePen(C=flatten(cntr_prnt.G), C_2=config_pen.primary_config_for_3dp_f_2, start_and_end_g_code=True)  # -> g_code, pt, pl
dedomain_5 = DeconstructDomain(Domain=debox_4.X)  # -> Start, End
dedomain_6 = DeconstructDomain(Domain=debox_4.Y)  # -> Start, End
division_6 = Division(A=len_12, B=config_pen.print_speed_mm_sec_4)
division_7 = Division(A=multiplication_4, B=config_pen.z_rapid_speed_mm_sec_4)
ma = MassAddition(Input=division_6)  # -> Result, PartialResults
ma_2 = MassAddition(Input=flatten([division_7, division_6]))  # -> Result, PartialResults
save_gc = SaveGcode(
    gcode=print_crv__p.g_code,
    file_path="/Volumes/courses/IS380_01_0483 - Bastardize Machines  A Romance/LIAM/gcode/140 x 140 column/186column.gcode",
    save=Button())
subtraction_6 = Subtraction(A=dedomain_5.End, B=dedomain_5.Start)
subtraction_7 = Subtraction(A=dedomain_6.End, B=dedomain_6.Start)
panel_9 = Panel([ma_2.Result, ma.Result])
panel_10 = Panel([subtraction_6, subtraction_7])
time_estimate = TimeEstimate(crv=cntr_prnt.G, C=config_pen.primary_config_for_3dp_f_2)
panel_11 = Panel(time_estimate)

# ---- group: changing xylinus to change feedrate (continued)
bbox_11 = BoundingBox(Content=crv_12, Plane=PlaneXY(0, 0, 0), UnionBox=True)  # -> Box, Box_2
debox_5 = DeconstructBox(Box=bbox_11.Box)  # -> Plane, X, Y, Z
bbox_12 = BoundingBox(Content=crv_12, Plane=PlaneXY(0, 0, 0), UnionBox=True)  # -> Box, Box_2
dedomain_7 = DeconstructDomain(Domain=debox_5.X)  # -> Start, End
dedomain_8 = DeconstructDomain(Domain=debox_5.Y)  # -> Start, End
debox_6 = DeconstructBox(Box=bbox_12.Box)  # -> Plane, X, Y, Z
subtraction_8 = Subtraction(A=dedomain_8.End, B=dedomain_8.Start)
subtraction_9 = Subtraction(A=dedomain_7.End, B=dedomain_7.Start)
dedomain_9 = DeconstructDomain(Domain=debox_6.X)  # -> Start, End
dedomain_10 = DeconstructDomain(Domain=debox_6.Y)  # -> Start, End
division_8 = Division(A=target_dimension_4, B=subtraction_9)
division_9 = Division(A=target_dimension_5, B=subtraction_8)
min_2 = Minimum(A=division_8, B=division_9)
subtraction_10 = Subtraction(A=dedomain_10.End, B=dedomain_10.Start)
subtraction_11 = Subtraction(A=dedomain_9.End, B=dedomain_9.Start)
max_2 = Maximum(A=subtraction_11, B=subtraction_10)
division_10 = Division(A=target_dimension_6, B=max_2)
scale_5 = Scale(Geometry=crv_12, Center=Point(0, 0, 0), Factor=min_2)  # -> Geometry, Transform
scale_6 = Scale(Geometry=crv_12, Center=Point(0, 0, 0), Factor=division_10)  # -> Geometry, Transform
cntr_prnt_2 = CenterPrintOnPrintBed(geo=scale_5.Geometry, printer_volume_box=config_pen_2.primary_config_for_3dp_f_2)  # -> G, bed_center, edges_of_printer_build_area, fits
lng_3 = ListLength(List=flatten(cntr_prnt_2.G))
bbox_13 = BoundingBox(Content=cntr_prnt_2.G, Plane=PlaneXY(0, 0, 0), UnionBox=True)  # -> Box, Box_2
multiplication_5 = Multiplication(A=lng_3, B=2)
debox_7 = DeconstructBox(Box=bbox_13.Box)  # -> Plane, X, Y, Z
multiplication_6 = Multiplication(A=config_pen_2.z_clearance_start_and_end_mm_4, B=multiplication_5)
len_13 = Length(Curve=flatten(cntr_prnt_2.G))
dedomain_11 = DeconstructDomain(Domain=debox_7.X)  # -> Start, End
dedomain_12 = DeconstructDomain(Domain=debox_7.Y)  # -> Start, End
division_11 = Division(A=len_13, B=config_pen_2.print_speed_mm_sec_4)
division_12 = Division(A=multiplication_6, B=config_pen_2.z_rapid_speed_mm_sec_4)
ma_3 = MassAddition(Input=division_11)  # -> Result, PartialResults
ma_4 = MassAddition(Input=flatten([division_12, division_11]))  # -> Result, PartialResults
subtraction_12 = Subtraction(A=dedomain_11.End, B=dedomain_11.Start)
subtraction_13 = Subtraction(A=dedomain_12.End, B=dedomain_12.Start)
panel_12 = Panel([ma_4.Result, ma_3.Result])
panel_13 = Panel([subtraction_12, subtraction_13])
time_estimate_2 = TimeEstimate(crv=cntr_prnt_2.G, C=config_pen_2.primary_config_for_3dp_f_2)
panel_14 = Panel(time_estimate_2)

# ----
move_2 = Move(Geometry=cntr_prnt_2.G, Motion=X)  # -> Geometry, Transform
panel_15 = Panel(move_2.Geometry)
move_3 = Move(Geometry=move_2.Geometry, Motion=Y_2)  # -> Geometry, Transform

# ----
# changed from z print to z rapid
print_crv__p_slow = PrintCurvePen(C=flatten(move_3.Geometry), C_2=config_pen_2.primary_config_for_3dp_f_2, start_and_end_g_code=True)  # -> g_code, pt, pl

# ---- group: changing xylinus to change feedrate (continued)
save_gc_2 = SaveGcode(gcode=print_crv__p_slow.g_code, file_path="/Users/liamdavis/Documents/slow column/COLUMN243.GCODE", save=Button())

# ----
panel_16 = Panel(print_crv__p_slow.g_code)

# ==== cluster PrintCurvePen: Converts a curve into Gcode to draw with a pen-based printer
C = ClusterInput()
C_2 = ClusterInput()
start_and_end_g_code = ClusterInput()  # Boolean input to determine wether or not to add the start and end g code needed to intiate and end a print. You may also adda customized start and end gcode sequences from the Start G Code and the End G Code components.
config_pen = ConfigPen(primary_config_for_3dp_f=C_2)  # -> printer_volume_domain_box_4, xy_tolerance_mm_4, line_width_mm_4, print_speed_mm_sec_4, xy_rapid_speed_mm_sec_4, z_rapid_speed_mm_sec_4, z_clearance_mm_4, z_clearance_start_and_end_mm_4, primary_config_for_3dp_f_2
crv = Curve(C)
crv_to_gc = CurveToGCode(crv=crv, tolerance_or_xylinus_config=config_pen.xy_tolerance_mm_4)  # -> g_code, pt_2, crv_4
pt = ClusterOutput(crv_to_gc.pt_2)
pl = ClusterOutput(crv_to_gc.crv_4)

# ---- group: first point info
item = ListItem(List=crv_to_gc.pt_2, Index=0, Wrap=True)
pdecon = Deconstruct(Point=item)  # -> XComponent, YComponent, ZComponent

# ---- group: move to first XY position at rapid speed
xy_rapid_speed_mm_min = Number(flatten(config_pen.xy_rapid_speed_mm_sec_4))
format = Format(Format="G1 X{0} Y{1} F{2}", Culture=127, Data0=pdecon.XComponent, Data1=pdecon.YComponent, Data2=xy_rapid_speed_mm_min)
panel = Panel(format)

# ---- group: begin printing and set print speed
item_2 = ListItem(List=crv_to_gc.g_code, Index="1", Wrap=True)
print_speed_mm_min = Number(config_pen.print_speed_mm_sec_4)
format_2 = Format(Format="{0} F{1}", Culture=127, Data0=item_2, Data1=print_speed_mm_min)
panel_2 = Panel(format_2)

# ----
z_rapid_speed_mm_min = Number(config_pen.z_rapid_speed_mm_sec_4)

# ---- group: move down in z at print speed
# changed from print speed to rapid speed
panel_3 = Panel("G1 Z{0} F{1}")
print_speed_mm_min_2 = Number(config_pen.print_speed_mm_sec_4)
format_3 = Format(Format=panel_3, Culture=127, Data0=pdecon.ZComponent, Data1=z_rapid_speed_mm_min)
panel_4 = Panel(format_3)

# ---- group: continue printing
split = SplitList(List=crv_to_gc.g_code, Index="2")  # -> ListA, ListB
trim = TrimTree(Tree=split.ListB, Depth=1)
panel_5 = Panel(trim)

# ----
item_3 = ListItem(List=config_pen.z_clearance_start_and_end_mm_4, Index=0, Wrap=True)  # -> Item, Item1

# ---- group: default start and end code / start commands / set units to mm
panel_6 = Panel("G21")

# ---- group: default start and end code / start commands / home all axiis
panel_7 = Panel("G28")

# ---- group: default start and end code / start commands
merge = Merge(Data4=flatten(panel_6), Data5=flatten(panel_7))

# ---- group: move up in z at rapid speed
item_4 = ListItem(List=[config_pen.z_clearance_start_and_end_mm_4, config_pen.z_clearance_mm_4], Index=0, Wrap=True)
z_clearance = Number(item_4)
z_rapid_speed_mm_min_2 = Number(config_pen.z_rapid_speed_mm_sec_4)

# ----
replace = ReplacePaths(Data=z_clearance, Search=["{8}", "{7}"], Replace=["{0;0}", "{0;1}"])

# ---- group: move up in z at rapid speed (continued)
long = LongestList(ListA=replace, ListB=pdecon.ZComponent, PaddingMode=2)  # -> ListA, ListB

# ----
max = Maximum(A=long.ListA, B=long.ListB)

# ---- group: move up in z at rapid speed (continued)
null_coalescing = NullCoalescing(primary_data=max, secondary_data=pdecon.ZComponent)
format_4 = Format(Format="G1 Z{0} F{1}", Culture=127, Data0=null_coalescing, Data1=z_rapid_speed_mm_min_2)
panel_8 = Panel(format_4)

# ----
merge_2 = Merge(Data1=format_4, Data2=format, Data3=format_3, Data4=format_2, Data5=trim)

# ---- group: default start and end code / lift up in the Z
number_slider = Slider(10, range=0..25)
z_clearance_2 = Number(item_3.Item1)
z_rapid_speed_mm_min_3 = Number(config_pen.z_rapid_speed_mm_sec_4)

# ---- group: default start and end code
null_coalescing_2 = NullCoalescing(primary_data=z_clearance_2, secondary_data=number_slider)

# ---- group: default start and end code / lift up in the Z (continued)
format_5 = Format(Format="G1 Z{0} F{1}", Culture=127, Data0=null_coalescing_2, Data1=z_rapid_speed_mm_min_3)

# ---- group: default start and end code / end commands
panel_9 = Panel("""G28 X0 Y0
M84""")
merge_3 = Merge(Data1=flatten("M400"), Data2=flatten(format_5), Data3=flatten(panel_9))

# ----
start_and_end_g_code_2 = Data(start_and_end_g_code)

# ---- group: if passed boolean true (=1)
item_5 = ListItem(List=flatten(start_and_end_g_code_2), Index=0, Wrap=True)
lng = ListLength(List=flatten(start_and_end_g_code_2))
bool = Boolean(flatten(item_5))
smaller = SmallerThan(FirstNumber=lng, SecondNumber=1)  # -> SmallerThan, OrEqualTo
and = GateAnd(A=bool, B=smaller.OrEqualTo)

# ---- group: if passed g code (=2)
lng_2 = ListLength(List=flatten(start_and_end_g_code_2))
larger = LargerThan(FirstNumber=lng_2, SecondNumber=1)  # -> LargerThan, OrEqualTo
and_2 = GateAnd(B=larger.LargerThan)
multiplication = Multiplication(A=and_2, B=2)

# ---- group: split into start and end g code
split_2 = SplitTree(Data=start_and_end_g_code_2, Masks=flatten("{1}"))  # -> Positive, Negative
start_g_code = Data(split_2.Negative)
end_g_code = Data(split_2.Positive)

# ----
addition = Addition(A=and, B=multiplication)

# ---- group: start code
filter = StreamFilter(Gate=addition, Stream1=merge, Stream2=start_g_code)

# ---- group: end code
filter_2 = StreamFilter(Gate=addition, Stream1=merge_3, Stream2=end_g_code)

# ----
merge_4 = Merge(Data1=flatten(filter), Data2=flatten(merge_2), Data3=flatten(filter_2))
g_code = ClusterOutput(merge_4)  # Complete g code for printing a single wall model with no infill

# ==== cluster ConfigDFabPrusa_P: Config Pen with setting for the dFab Prusa Pen-based printer.
print_speed = Slider(25, range=0..200)

# ---- group: originally 20 now 3
z_rapid_speed = Slider(3, range=0..200)

# ----
xy_rapid_speed = Slider(80, range=0..200)
z_clearance_start = Slider(15, range=0..50)
xy_tolerance = Slider(0.01, range=0..1)
x_dimension = Slider(200, range=0..500)
z_dimension = Slider(150, range=0..500)
y_dimension = Slider(200, range=0..500)
z_clearance_end = Slider(25, range=0..50)
line_width = Slider(0.1, range=0..1)
z_clearance = Slider(5, range=0..10)
box = DomainBox(Base=PlaneXY(0, 0, 0), X=x_dimension, Y=y_dimension, Z=z_dimension)
config_pen = ConfigPen(
    printer_volume_domain_box=box,
    xy_tolerance_mm=xy_tolerance,
    line_width_mm=line_width,
    print_speed_mm_sec=print_speed,
    xy_rapid_speed_mm_sec=xy_rapid_speed,
    z_rapid_speed_mm_sec=z_rapid_speed,
    z_clearance_mm=z_clearance,
    z_clearance_start_and_end_mm=[z_clearance_start, z_clearance_end])  # -> printer_volume_domain_box_4, xy_tolerance_mm_4, line_width_mm_4, print_speed_mm_sec_4, xy_rapid_speed_mm_sec_4, z_rapid_speed_mm_sec_4, z_clearance_mm_4, z_clearance_start_and_end_mm_4, primary_config_for_3dp_f_2
C = ClusterOutput(config_pen.primary_config_for_3dp_f_2)

# ==== cluster CenterPrintOnPrintBed: Moves the input geometry to the center of the print bed as determined by the input printer dimesions.
printer_volume_box = ClusterInput()  # input a box the corresponds to the printer's build volume and home location, or input a Xylinus Config containing that information.

# ---- group: get print dimesions and bottom center
geo = ClusterInput()
geo_2 = Geometry(geo)
bbox = BoundingBox(Content=flatten(geo_2), Plane=PlaneXY(0, 0, 0), UnionBox=True)  # -> Box, Box_2
box = EvaluateBox(Box=bbox.Box, UParameter=0.5, VParameter=0.5, WParameter=0)  # -> Plane, Point, Include

# ----
data = Data(printer_volume_box)
list = ValueList({"0", "1", "2", "3", "4", "5", "6", "7", "8", "9", "10", "11", "12", "13", "14", "15", "16", "17", "18", "19", "20"}, selected="1")
setting = ConfigSetting_2(config=data, setting_number=list)  # -> setting_2, is_config

# ---- group: get printer dimensions and bottom center
box_2 = Box(setting.setting_2)
edges = BrepEdges(Brep=box_2)  # -> Naked, Interior, NonManifold
box_3 = EvaluateBox(Box=box_2, UParameter=0.5, VParameter=0.5, WParameter=0)  # -> Plane, Point, Include
bed_center = ClusterOutput(box_3.Point)
edges_of_printer_build_area = ClusterOutput(edges.Interior)

# ---- group: confirm print fits in printer
debox = DeconstructBox(Box=bbox.Box)  # -> Plane, X, Y, Z
debox_2 = DeconstructBox(Box=box_2)  # -> Plane, X, Y, Z
smaller = SmallerThan(FirstNumber=debox.X, SecondNumber=debox_2.X)  # -> SmallerThan, OrEqualTo
smaller_2 = SmallerThan(FirstNumber=debox.Y, SecondNumber=debox_2.Y)  # -> SmallerThan, OrEqualTo
smaller_3 = SmallerThan(FirstNumber=debox.Z, SecondNumber=debox_2.Z)  # -> SmallerThan, OrEqualTo
and = GateAnd(A=smaller.SmallerThan, B=smaller_2.SmallerThan, C=smaller_3.SmallerThan)
fits = ClusterOutput(and)  # Does the print fit within the bounding box of the printer?

# ---- group: move print to bed center
vec2pt = Vector2Pt(PointA=box.Point, PointB=box_3.Point, Unitize=False)  # -> Vector, Length
move = Move(Geometry=geo_2, Motion=vec2pt.Vector)  # -> Geometry, Transform
G = ClusterOutput(move.Geometry)

# ==== cluster SaveGcode: Writes gCode to the specified file.
gcode = ClusterInput()  # Gcode to export.
file_path = ClusterInput()  # Path to file where Gcode will be exported. The file should end with a .gcode extension.
save = ClusterInput()  # Set to True to export the Gcode to the file. Leaving this set to true will result in contnuos updates whenever there is a change upstream.
txt = Text(gcode)
path = FilePath(file_path)
bool = Boolean(save)
save_gc = GhPythonScript(GC=txt, P=path, S=bool)  # -> msg; inputs GC: list, S: Boolean
# ---------- save_gc: Python ----------
from ghpythonlib.componentbase import executingcomponent as component
import Grasshopper, GhPython
import System
import time
class MyComponent(component):
    
    def RunScript(self, GC, P, S):
        """Provides a scripting component.
            Inputs:
                GC: Gcode
                P: File Path
                S: Save
            Output:
                msg: Message"""
        __author__ = "rhoover"
        __version__ = "2020.04.25"
        
        msg=" "
        if(P):
            msg="Ready to save " + str(len(GC)) + " lines of Gcode to " + P 
            if (S):
                with open(P, 'w') as f:
                    f.writelines("%s\n" % line for line in GC)
                    msg=(str(len(GC)) + " lines of Gcode saved to " + P + " on " + time.ctime())
                f.close()
        else:
            msg="Set the file path for output destination"
        # return outputs if you have them; here I try it for you:
        return msg
# ---------- end save_gc ----------
status_message = ClusterOutput(save_gc)

# ==== cluster TimeEstimate: estimate time of print
C = ClusterInput()
config_pen = ConfigPen(primary_config_for_3dp_f=C)  # -> printer_volume_domain_box_4, xy_tolerance_mm_4, line_width_mm_4, print_speed_mm_sec_4, xy_rapid_speed_mm_sec_4, z_rapid_speed_mm_sec_4, z_clearance_mm_4, z_clearance_start_and_end_mm_4, primary_config_for_3dp_f_2
crv = ClusterInput()
crv_2 = Curve(crv)
len = Length(Curve=flatten(crv_2))
lng = ListLength(List=len)
ma = MassAddition(Input=len)  # -> Result, PartialResults
multiplication = Multiplication(A=lng, B=config_pen.z_clearance_mm_4)
division = Division(A=ma.Result, B=config_pen.print_speed_mm_sec_4)
multiplication_2 = Multiplication(A=multiplication, B=2)
division_2 = Division(A=multiplication_2, B=config_pen.z_rapid_speed_mm_sec_4)
end = EndPoints(Curve=flatten(crv_2))  # -> Start, End
shift = ShiftList(List=end.Start, Shift=1, Wrap=True)
ln = Line(StartPoint=end.End, EndPoint=shift)
dist = Distance(PointA=end.End, PointB=shift)
ma_2 = MassAddition(Input=dist)  # -> Result, PartialResults
division_3 = Division(A=ma_2.Result, B=config_pen.xy_rapid_speed_mm_sec_4)
ma_3 = MassAddition(Input=flatten([division_3, division_2, division]))  # -> Result, PartialResults
R = ClusterOutput(ma_3.Result)

# ==== cluster NullCoalescing: Passes the primary data input, unless it is null. In which case it passes the secondary data input to the output. (Like the ?? operator in C#)
primary_data = ClusterInput()  # If this input is not null, it will be passed tot he output.
secondary_data = ClusterInput()  # If the input to the primary data is null, this will be passed to the output.
data = Data(primary_data)
data_2 = Data(secondary_data)
null = NullItem(Item=data)  # -> NullFlags, InvalidFlags, Description
filter = StreamFilter(Gate=null.NullFlags, Stream0=data, Stream1=data_2)
data_3 = Data(filter)
data_4 = ClusterOutput(data_3)

# ==== cluster CurveToGCode: Converts a cureve into g code to 3D print with a standard filament based printer
crv = ClusterInput()
tolerance_or_xylinus_config = ClusterInput()
list = ValueList({"0", "1", "2", "3", "4", "5", "6", "7", "8", "9", "10", "11", "12", "13", "14", "15", "16", "17", "18", "19", "20"}, selected="3")
data = Data(tolerance_or_xylinus_config)
setting = ConfigSetting(config=data, setting_number=list)
xy_tolerance_mm = Number(flatten(setting))
crv_2 = Curve(crv)

# ---- group: points to gcode / set the # of decimal places included in the point to be 1 more than included in the XY resolution
split = TextSplit(Text=setting, Separators=".")
item = ListItem(List=split, Index=1, Wrap=True)
len = TextLength(Text=item)
addition = Addition(A=len, B=1)

# ---- group: points to gcode
topoly = CurveToPolyline(Curve=crv_2, ToleranceDistance=xy_tolerance_mm, ToleranceAngle=0)  # -> Polyline, Segments
explode = Explode(Curve=topoly.Polyline, Recursive=True)  # -> Segments, Vertices

# ---- group: points to gcode / set the # of decimal places included in the point to be 1 more than included in the XY resolution (continued)
roundto = CSharpScript(p=explode.Vertices, d=addition)  # -> P; inputs p: Point3d, d: Int32
# ---------- roundto: C# ----------
    Rhino.Geometry.Point3d prnd = new Rhino.Geometry.Point3d();

    prnd.X = System.Math.Round(p.X, d);
    prnd.Y = System.Math.Round(p.Y, d);
    prnd.Z = System.Math.Round(p.Z, d);
    P = prnd;
# ---------- end roundto ----------

# ----
crv_3 = Curve(topoly.Polyline)
pt = Point(roundto)

# ---- group: points to gcode (continued)
pdecon = Deconstruct(Point=roundto)  # -> XComponent, YComponent, ZComponent
format = Format(Format="G1 X{0} Y{1} Z{2}", Culture=127, Data0=pdecon.XComponent, Data1=pdecon.YComponent, Data2=pdecon.ZComponent)

# ----
g_code = ClusterOutput(format)  # Complete g code for printing a single wall model with no infill
crv_4 = ClusterOutput(crv_3)
pt_2 = ClusterOutput(pt)

# ==== cluster ConfigPen: This component holds the primary configurations needed for drawing with a pen-based printer. These settings can be passed to or from this component as a condensed list. Settings can also be broken out and fed into Xylinus sub-routines. Settings can be modified through the specific inputs, which will override the condensed config input.
z_clearance_start_and_end_mm = ClusterInput()
z_clearance_mm = ClusterInput()
line_width_mm = ClusterInput()

xy_rapid_speed_mm_sec = ClusterInput()
z_rapid_speed_mm_sec = ClusterInput()
printer_volume_domain_box = ClusterInput()  # Input a box with X,Y,and Z domains that match the dimensions of your printer. This can easily be created with the Domain Box component. If your printer 0 position is in the bottom left corner (as standard) you can simply use the default world XY plane, and just enter the the dimesions of your printer into the X, Y, and Z inputs.
print_speed_mm_sec = ClusterInput()
xy_tolerance_mm = ClusterInput()
print_speed_mm_sec_2 = Number(print_speed_mm_sec)
z_rapid_speed_mm_sec_2 = Number(z_rapid_speed_mm_sec)
xy_rapid_speed_mm_sec_2 = Number(xy_rapid_speed_mm_sec)
xy_tolerance_mm_2 = Number(xy_tolerance_mm)
printer_volume_domain_box_2 = Box(printer_volume_domain_box)
line_width_mm_2 = Number(line_width_mm)
xy_rapid_speed_mm_min = Number(expr("x*60", xy_rapid_speed_mm_sec_2))
z_rapid_speed_mm_min = Number(expr("x*60", z_rapid_speed_mm_sec_2))
print_speed_mm_min = Number(expr("x*60", print_speed_mm_sec_2))

z_clearance_start_and_end_mm_2 = Number(z_clearance_start_and_end_mm)
z_clearance_mm_2 = Number(z_clearance_mm)
primary_config_for_3dp_f = ClusterInput()  # Optional configuration for 3D printing with filament. Direct entries will override these config entries.

panel = Panel("""Config Filament
printer volume domain box
XY tolerance (mm)
line width (mm)
print speed (mm/sec)
XY rapid speed (mm/sec)
Z rapid speed (mm/sec)
Z clearance (mm)
Z clearance start and end (mm)""")
list = ValueList({"0", "1", "2", "3", "4", "5", "6", "7", "8", "9", "10", "11", "12", "13", "14", "15", "16", "17", "18", "19", "20"}, selected="0")
set_pass = SettingPasser(setting=panel, config=primary_config_for_3dp_f, setting_number=list)
config_type = Text(set_pass)

list_2 = ValueList({"0", "1", "2", "3", "4", "5", "6", "7", "8", "9", "10", "11", "12", "13", "14", "15", "16", "17", "18", "19", "20"}, selected="2")
list_3 = ValueList({"0", "1", "2", "3", "4", "5", "6", "7", "8", "9", "10", "11", "12", "13", "14", "15", "16", "17", "18", "19", "20"}, selected="4")
list_4 = ValueList({"0", "1", "2", "3", "4", "5", "6", "7", "8", "9", "10", "11", "12", "13", "14", "15", "16", "17", "18", "19", "20"}, selected="5")
list_5 = ValueList({"0", "1", "2", "3", "4", "5", "6", "7", "8", "9", "10", "11", "12", "13", "14", "15", "16", "17", "18", "19", "20"}, selected="6")
list_6 = ValueList({"0", "1", "2", "3", "4", "5", "6", "7", "8", "9", "10", "11", "12", "13", "14", "15", "16", "17", "18", "19", "20"}, selected="7")
list_7 = ValueList({"0", "1", "2", "3", "4", "5", "6", "7", "8", "9", "10", "11", "12", "13", "14", "15", "16", "17", "18", "19", "20"}, selected="8")
list_8 = ValueList({"0", "1", "2", "3", "4", "5", "6", "7", "8", "9", "10", "11", "12", "13", "14", "15", "16", "17", "18", "19", "20"}, selected="10")  # disabled
list_9 = ValueList({"0", "1", "2", "3", "4", "5", "6", "7", "8", "9", "10", "11", "12", "13", "14", "15", "16", "17", "18", "19", "20"}, selected="11")  # disabled
list_10 = ValueList({"0", "1", "2", "3", "4", "5", "6", "7", "8", "9", "10", "11", "12", "13", "14", "15", "16", "17", "18", "19", "20"}, selected="12")  # disabled
list_11 = ValueList({"0", "1", "2", "3", "4", "5", "6", "7", "8", "9", "10", "11", "12", "13", "14", "15", "16", "17", "18", "19", "20"}, selected="13")  # disabled
list_12 = ValueList({"0", "1", "2", "3", "4", "5", "6", "7", "8", "9", "10", "11", "12", "13", "14", "15", "16", "17", "18", "19", "20"}, selected="14")  # disabled
list_13 = ValueList({"0", "1", "2", "3", "4", "5", "6", "7", "8", "9", "10", "11", "12", "13", "14", "15", "16", "17", "18", "19", "20"}, selected="15")  # disabled
list_14 = ValueList({"0", "1", "2", "3", "4", "5", "6", "7", "8", "9", "10", "11", "12", "13", "14", "15", "16", "17", "18", "19", "20"}, selected="1")
list_15 = ValueList({"0", "1", "2", "3", "4", "5", "6", "7", "8", "9", "10", "11", "12", "13", "14", "15", "16", "17", "18", "19", "20"}, selected="3")
list_16 = ValueList({"0", "1", "2", "3", "4", "5", "6", "7", "8", "9", "10", "11", "12", "13", "14", "15", "16", "17", "18", "19", "20"}, selected="9")  # disabled
set_pass_2 = SettingPasser(setting=xy_tolerance_mm_2, config=primary_config_for_3dp_f, setting_number=list_2)
set_pass_3 = SettingPasser(setting=print_speed_mm_min, config=primary_config_for_3dp_f, setting_number=list_3)
set_pass_4 = SettingPasser(setting=xy_rapid_speed_mm_min, config=primary_config_for_3dp_f, setting_number=list_4)
set_pass_5 = SettingPasser(setting=z_rapid_speed_mm_min, config=primary_config_for_3dp_f, setting_number=list_5)
set_pass_6 = SettingPasser(setting=z_clearance_mm_2, config=primary_config_for_3dp_f, setting_number=list_6)
set_pass_7 = SettingPasser(setting=z_clearance_start_and_end_mm_2, config=primary_config_for_3dp_f, setting_number=list_7)
set_pass_8 = SettingPasser(config=primary_config_for_3dp_f, setting_number=list_8)  # disabled
set_pass_9 = SettingPasser(config=primary_config_for_3dp_f, setting_number=list_9)  # disabled
set_pass_10 = SettingPasser(config=primary_config_for_3dp_f, setting_number=list_10)  # disabled
set_pass_11 = SettingPasser(config=primary_config_for_3dp_f, setting_number=list_11)  # disabled
set_pass_12 = SettingPasser(config=primary_config_for_3dp_f, setting_number=list_12)  # disabled
set_pass_13 = SettingPasser(config=primary_config_for_3dp_f, setting_number=list_13)  # disabled
set_pass_14 = SettingPasser(setting=printer_volume_domain_box_2, config=primary_config_for_3dp_f, setting_number=list_14)
set_pass_15 = SettingPasser(setting=line_width_mm_2, config=primary_config_for_3dp_f, setting_number=list_15)
set_pass_16 = SettingPasser(config=primary_config_for_3dp_f, setting_number=list_16)  # disabled

printer_volume_domain_box_3 = Box(set_pass_14)
xy_rapid_speed_mm_sec_3 = Number(set_pass_4)
z_rapid_speed_mm_sec_3 = Number(set_pass_5)
print_speed_mm_sec_3 = Number(set_pass_3)
line_width_mm_3 = Number(set_pass_15)
xy_tolerance_mm_3 = Number(set_pass_2)
printer_volume_domain_box_4 = ClusterOutput(printer_volume_domain_box_3)
xy_tolerance_mm_4 = ClusterOutput(xy_tolerance_mm_3)
print_speed_mm_sec_4 = ClusterOutput(print_speed_mm_sec_3)
xy_rapid_speed_mm_sec_4 = ClusterOutput(xy_rapid_speed_mm_sec_3)
z_rapid_speed_mm_sec_4 = ClusterOutput(z_rapid_speed_mm_sec_3)

z_clearance_start_and_end_mm_3 = Number(set_pass_7)
z_clearance_mm_3 = Number(set_pass_6)
data = Data([config_type, printer_volume_domain_box_3, xy_tolerance_mm_3, line_width_mm_3, print_speed_mm_sec_3, xy_rapid_speed_mm_sec_3, z_rapid_speed_mm_sec_3, z_clearance_mm_3, z_clearance_start_and_end_mm_3])
line_width_mm_4 = ClusterOutput(line_width_mm_3)
z_clearance_mm_4 = ClusterOutput(z_clearance_mm_3)
z_clearance_start_and_end_mm_4 = ClusterOutput(z_clearance_start_and_end_mm_3)
primary_config_for_3dp_f_2 = ClusterOutput(data)  # primary configurations for 3D printing with filament

# ==== cluster ConfigSetting_2: If an individual specific setting is input in S, it will be returned. Otherwise the config (C) setting, matching the input ID will be passed. The ID is an integer matching the branch number of the desired setting. The returned setting will have the data structure matching the input ID. Is anything other than a Xylinus Config is input to C, that data will simply be passed to S.
config = ClusterInput()
setting_number = ClusterInput()  # input an integer matching the branch number of the desired setting.
data = Data(config)
int = Integer(setting_number)
path = ConstructPath(Indices=int)

# ---- group: is it a config?
item = TreeItem(Tree=data, Path="{0}", Index=0, Wrap=True)
tmatch = MatchText(Text=item, RegEx="config", Case=False)
int_2 = Integer(tmatch)
null = NullItem(Item=int_2)  # -> NullFlags, InvalidFlags, Description
filter = StreamFilter(Gate=null.NullFlags, Stream0=int_2, Stream1=0)

# ---- group: if so, pull the requested setting
branch = TreeBranch(Tree=data, Path=path, MaintainPaths=True)

# ---- group: otherwise, just pass the input data
filter_2 = StreamFilter(Gate=filter, Stream0=data, Stream1=branch)
data_2 = Data(filter_2)

# ---- group: if something is passed in the Setting, use that value.
setting = ClusterInput()  # Individual specific setting. Will override the config setting.
data_3 = Data(setting)
null_coalescing = NullCoalescing(primary_data=data_3, secondary_data=data_2)

# ----
null_2 = NullItem(Item=data_3)  # -> NullFlags, InvalidFlags, Description
and = GateAnd(A=filter, B=null_2.NullFlags)
bool = Boolean(and)
is_config = ClusterOutput(bool)  # Boolean indicating whether or not the dat being passed is derived from a config

# ---- group: make the data structure match what is expected from the input
replace = ReplacePaths(Data=flatten(null_coalescing), Search="{0}", Replace=path)
setting_2 = ClusterOutput(replace)

# ==== cluster ConfigSetting: If an individual specific setting is input in S, it will be returned. Otherwise the config (C) setting, matching the input ID will be passed. The ID is an integer matching the branch number of the desired setting. The returned setting will have the data structure matching the input ID. Is anything other than a Xylinus Config is input to C, that data will simply be passed to S.
config = ClusterInput()
setting_number = ClusterInput()  # input an integer matching the branch number of the desired setting.
data = Data(config)
int = Integer(setting_number)

# ---- group: is it a config?
branch = TreeBranch(Tree=data, Path="{0}", MaintainPaths=True)
tmatch = MatchText(Text=branch, RegEx="config", Case=False)
int_2 = Integer(tmatch)
null = NullItem(Item=int_2)  # -> NullFlags, InvalidFlags, Description
filter = StreamFilter(Gate=null.NullFlags, Stream0=int_2, Stream1=0)

# ----
path = ConstructPath(Indices=int)

# ---- group: if so, pull the requested setting
branch_2 = TreeBranch(Tree=data, Path=path, MaintainPaths=True)

# ---- group: otherwise, just pass the input data
filter_2 = StreamFilter(Gate=filter, Stream0=data, Stream1=branch_2)
data_2 = Data(filter_2)

# ---- group: if something is passed in the Setting, use that value.
setting = ClusterInput()  # Individual specific setting. Will override the config setting.
data_3 = Data(setting)
null_coalescing = NullCoalescing(primary_data=data_3, secondary_data=data_2)

# ---- group: make the data structure match what is expected from the input
replace = ReplacePaths(Data=flatten(null_coalescing), Search="{0}", Replace=path)
setting_2 = ClusterOutput(replace)

# ==== cluster SettingPasser: If an individual specific setting is input in S, it will be returned. Otherwise the config (C) setting, matching the input ID will be passed. The ID is an integer matching the branch number of the desired setting. The returned setting will have the data structure matching the input ID.
setting = ClusterInput()  # Individual specific setting. Will override the config setting.
config = ClusterInput()
setting_number = ClusterInput()  # input an integer matching the branch number of the desired setting.
data = Data(config)
int = Integer(setting_number)
data_2 = Data(setting)
path = ConstructPath(Indices=int)
null = NullItem(Item=data_2)  # -> NullFlags, InvalidFlags, Description
branch = TreeBranch(Tree=data, Path=path, MaintainPaths=True)
filter = StreamFilter(Gate=null.NullFlags, Stream0=data_2, Stream1=branch)
replace = ReplacePaths(Data=flatten(filter), Search="{0}", Replace=path)
setting_2 = ClusterOutput(replace)
