# Grasshopper definition lightprinter_control.gh (Grasshopper 1.0.7)
# plug-ins: Pufferfish

# ---- group: light printer geo - baked into rhino
pt = ConstructPoint(XCoordinate="0", YCoordinate="0", ZCoordinate="0")
Y = UnitY(Factor=1)
multiplication = Multiplication(A=Slider(65.25, range=0..100), B="25.4")
line = LineSDL(Start=pt, Direction=Y, Length=multiplication)
X = UnitX(Factor=1)
end = EndPoints(Curve=line)  # -> Start, End
multiplication_2 = Multiplication(A=Slider(65.813, range=0..100), B="25.4")
multiplication_3 = Multiplication(A=Slider(65.625, range=0..100), B="25.4")
line_2 = LineSDL(Start=end.Start, Direction=X, Length=multiplication_3)
line_3 = LineSDL(Start=end.End, Direction=X, Length=multiplication_2)
end_2 = EndPoints(Curve=line_3)  # -> Start, End
end_3 = EndPoints(Curve=line_2)  # -> Start, End
ln = Line(StartPoint=end_2.End, EndPoint=end_3.End)
merge = Merge(Data1=ln, Data2=line_2, Data3=line_3, Data4=line)

# ----
number_slider = Slider(640, range=0..20000)
lightprinthead_v2_ld = Brep(<brep referenced from the Rhino model>)
lightprinthead_v2 = Brep(<brep referenced from the Rhino model>)
number_slider_2 = Slider(19, range=0..100)
center_of_print_area = Point(<point referenced from the Rhino model>)
center_of_printhead = Point(<point referenced from the Rhino model>)
panel = Panel("1.894")
cir = Circle(Plane=PlaneXY(0, 0, 0), Radius=Slider(640, range=0..20000))
multiplication_4 = Multiplication(A="0", B=25.4)
move2pt = MoveToPoint(Geometry=[lightprinthead_v2, lightprinthead_v2_ld], PointA=center_of_printhead, PointB=center_of_print_area)  # -> Moved, Vector, Transform
Z = UnitZ(Factor=multiplication_4)
move = Move(Geometry=move2pt.Moved, Motion=Z)  # -> Geometry, Transform
divide = DivideCurve(Curve=cir, Count=Slider(8, range=0..10), Kinks=False)  # -> Points, Tangents, Parameters
bbox = BoundingBox(Content=move.Geometry, Plane=PlaneXY(0, 0, 0))  # -> Box, Box_2
bvol = BoundaryVolume(Boundaries=lightprinthead_v2_ld)
item = ListItem(List=bbox.Box, Index=Slider(1, range=0..1), Wrap=True)
debrep = DeconstructBrep(Brep=item)  # -> Faces, Edges, Vertices

# ---- group: with lid
area = Area(Geometry=debrep.Faces)  # -> Area, Centroid
pdecon = Deconstruct(Point=area.Centroid)  # -> XComponent, YComponent, ZComponent
sort = SortList(Keys=pdecon.ZComponent, ValuesA=debrep.Faces)  # -> Keys, ValuesA
item_2 = ListItem(List=sort.ValuesA, Index="-1", Wrap=True)

# ---- group: without lid
pdecon_2 = Deconstruct(Point=debrep.Vertices)  # -> XComponent, YComponent, ZComponent
sort_2 = SortList(Keys=pdecon_2.ZComponent, ValuesA=debrep.Vertices)  # -> Keys, ValuesA
item_3 = ListItem(List=sort_2.ValuesA, Index=reverse(0), Wrap=True)  # -> Item, Item1, Item2, Item3

# ----
number_slider_3 = Slider(10, range=0..10)
area_2 = Area(Geometry=item_2)  # -> Area, Centroid
pt_2 = Point(<point referenced from the Rhino model>)
rectangle = Rectangle(Plane=area_2.Centroid, XSize=number_slider_3, YSize=number_slider_3, Radius=0)  # -> Rectangle, Length
debrep_2 = DeconstructBrep(Brep=rectangle.Rectangle)  # -> Faces, Edges, Vertices
item_4 = ListItem(List=debrep_2.Vertices, Index=0, Wrap=True)  # -> Item, Item1, Item2, Item3
y = Point(item_3.Item3)
z = Point(item_3.Item2)
x = Point(item_3.Item)
e = Point(item_3.Item1)
e_2 = Point(item_4.Item3)
x_2 = Point(item_4.Item)
ln_2 = Line(StartPoint=x_2, EndPoint=pt_2)
len = Length(Curve=ln_2)
panel_2 = Panel(len)
y_2 = Point(item_4.Item1)
z_2 = Point(item_4.Item2)

# ---- group: printhead connect points
x_3 = Point(x_2)
z_3 = Point(z_2)
y_3 = Point(e_2)
e_3 = Point(y_2)

# ----
lightcolumn_2 = Curve(<curve referenced from the Rhino model>)

test_print_head = Curve(<curve referenced from the Rhino model>)
pt_3 = Point(<point referenced from the Rhino model>)
pt_4 = Point(<point referenced from the Rhino model>)
pt_5 = Point(<point referenced from the Rhino model>)
pt_6 = Point(<point referenced from the Rhino model>)

freind = Curve(<curve referenced from the Rhino model>)

# ---- group: Printhead v1
pt_7 = Point(<point referenced from the Rhino model>)
pt_8 = Point(<point referenced from the Rhino model>)
pt_9 = Point(<point referenced from the Rhino model>)
pt_10 = Point(<point referenced from the Rhino model>)

# ----
lala = Curve(<curve referenced from the Rhino model>)
peng = Curve(<curve referenced from the Rhino model>)
area_3 = Area(Geometry=test_print_head)  # -> Area, Centroid
crv = Curve(<curve referenced from the Rhino model>)
roundy = Curve(<curve referenced from the Rhino model>)
crvlightcolumn = Curve(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)
light_column_2 = Curve(<curve referenced from the Rhino model>)
jingwen_shape = Curve(<curve referenced from the Rhino model>)
complicated_test = Curve(<curve referenced from the Rhino model>)
jingwen_star = Curve(<curve referenced from the Rhino model>)
liam_star = Curve(<curve referenced from the Rhino model>)
crv_2 = Curve(<curve referenced from the Rhino model>)
crv_3 = Curve(<curve referenced from the Rhino model>)
crv_4 = Curve(<curve referenced from the Rhino model>)
crv_5 = Curve(<curve referenced from the Rhino model>)
topoly = CurveToPolyline(Curve=crv, ToleranceDistance=Slider(1, range=0..1), ToleranceAngle=0, MinEdge=Slider(0, range=0..1000))  # -> Polyline, Segments
rec_3pt = Rectangle3Pt(PointA=x_3, PointB=y_3, PointC=z_3)  # -> Rectangle, Length
end_4 = EndPoints(Curve=crv_2)  # -> Start, End
end_5 = EndPoints(Curve=crv_3)  # -> Start, End
end_6 = EndPoints(Curve=crv_4)  # -> Start, End
end_7 = EndPoints(Curve=crv_5)  # -> Start, End
explode = Explode(Curve=topoly.Polyline, Recursive=True)  # -> Segments, Vertices
area_4 = Area(Geometry=rec_3pt.Rectangle)  # -> Area, Centroid
x_4 = Point(<point referenced from the Rhino model>)
y_4 = Point(<point referenced from the Rhino model>)
z_4 = Point(<point referenced from the Rhino model>)
e_4 = Point(<point referenced from the Rhino model>)
move2pt_2 = MoveToPoint(Geometry=rec_3pt.Rectangle, PointA=area_4.Centroid, PointB=explode.Vertices)  # -> Moved, Vector, Transform
explode_2 = Explode(Curve=move2pt_2.Moved, Recursive=True)  # -> Segments, Vertices
x_up = Point()
z_up = Point()
rec_3pt_2 = Rectangle3Pt(PointA=end_6.End, PointB=end_5.End, PointC=end_4.End)  # -> flatten(Rectangle), Length
cullpt = CullDuplicates(Points=explode_2.Vertices, Tolerance=0.1, CullMode=3)  # -> Points, Indices, Valence
explode_3 = Explode(Curve=rec_3pt_2.Rectangle, Recursive=True)  # -> Segments, Vertices
flip = FlipMatrix(Data=cullpt.Points)
cullpt_2 = CullDuplicates(Points=explode_3.Vertices, Tolerance=0.1, CullMode=3)  # -> graft(Points), Indices, Valence
dist = Distance(PointA=flip, PointB=cullpt_2.Points)  # -> simplify(Distance)

# ---- group: visualizer
ln_3 = Line(StartPoint=flip, EndPoint=cullpt_2.Points)  # -> simplify(Line)
item_5 = ListItem(List=ln_3, Index=Slider(582, range=0..1000), Wrap=True)  # -> flatten(Item)

# ----
branch = TreeBranch(Tree=dist, Path="0", MaintainPaths=True)
branch_2 = TreeBranch(Tree=dist, Path="1", MaintainPaths=True)
branch_3 = TreeBranch(Tree=dist, Path="2", MaintainPaths=True)
branch_4 = TreeBranch(Tree=dist, Path="3", MaintainPaths=True)
roundd = RoundToDecimalPlace(NumberX=branch, DecimalPlace="4", RoundType=0)  # -> Rounded, Difference
roundd_2 = RoundToDecimalPlace(NumberX=branch_2, DecimalPlace="4", RoundType=0)  # -> Rounded, Difference
roundd_3 = RoundToDecimalPlace(NumberX=branch_3, DecimalPlace="4", RoundType=0)  # -> Rounded, Difference
roundd_4 = RoundToDecimalPlace(NumberX=branch_4, DecimalPlace="4", RoundType=0)  # -> Rounded, Difference
panel_3 = Panel(dist)
format = Format(
    Format="G1 Y{0} Z{1} E{2} X{3};",
    Culture=127,
    Data0=roundd.Rounded,
    Data1=roundd_2.Rounded,
    Data2=roundd_3.Rounded,
    Data3=roundd_4.Rounded)
item_6 = ListItem(List=format, Index=0, Wrap=True)
concat = Concatenate(FragmentA=item_6, FragmentB=" F ", FragmentC=Slider(1589, range=0..10000))
format_2 = Format(Format="G1 Y{0} Z{0} E{0} X{0};", Culture=127, Data0=Slider(3506, range=0..10000))
merge_2 = Merge(Data1=flatten(concat), Data2=flatten(format), Data3=flatten(format_2))  # -> flatten(Result)
cull_i = CullIndex(List=merge_2, Indices="1", Wrap=True)
lng = ListLength(List=cull_i)
panel_4 = Panel("""G4 S5
G4 S10""")
subtraction = Subtraction(A=lng, B=1)
ins = InsertItems(List=cull_i, Item=panel_4, Indices=flatten(["1", subtraction]), Wrap=True)
panel_5 = Panel(ins)
